# Grasshopper definition cnc.gh (Grasshopper 1.0.7)
# plug-ins: Pufferfish

number_slider = Slider(100, range=0..100)
number_slider_2 = Slider(20, range=0..100)
rectangle = Rectangle(Plane=PlaneXY(0, 0, 0), XSize=number_slider, YSize=number_slider, Radius=0)  # -> Rectangle, Length
trigger = Trigger(Interval=10, TimerInterval=10, Target=python)
srf = Surface(rectangle.Rectangle)
boxrec = BoxRectangle(Rectangle=rectangle.Rectangle, Height=Slider(50, range=0..100))
geo = Geometry(<point referenced from the Rhino model>)
sdivide = DivideSurface(Surface=srf, UCount=number_slider_2, VCount=number_slider_2)  # -> flatten(Points), Normals, Parameters
python = GhPythonScript(state=Toggle(False))  # -> out, a, b; inputs state: Boolean
# ---------- python: Python ----------
from scriptcontext import sticky

if not state:
    sticky["valX"] = 0
    sticky["valY"] = 0
else:
    sticky["valX"] += 1

a = sticky["valX"]

if a % 101 == 0 and a != 0:
    sticky["valY"] += 1
b = sticky["valY"]
# ---------- end python ----------
trigger_2 = Trigger(Interval=10, TimerInterval=10, Target=python_2)
pull = PullPoint(Point=sdivide.Points, Geometry=geo, ClosestOnly=True)  # -> ClosestPoint, Distance
bnd = Bounds(Numbers=flatten(pull.Distance))
python_2 = GhPythonScript(state=Toggle(False))  # -> out, a; inputs state: Boolean
# ---------- python_2: Python ----------
from scriptcontext import sticky

if not state:
    sticky["X"] = 0
else:
    sticky["X"] += 1
a = sticky["X"]
# ---------- end python_2 ----------
srfgrid = SurfaceFromPoints(Points=sdivide.Points, UCount=Slider(21, range=0..100), Interpolate=False)
remap = RemapNumbers(Value=pull.Distance, Source=bnd, Target=Domain(0, 1))  # -> Mapped, Clipped
number_slider_3 = Slider(20, range=0..100)
pt = Point(<point referenced from the Rhino model>)
graph = GraphMapper(
    remap.Mapped,
    x0=0,
    x1=1,
    y0=0,
    y1=1,
    container_name="Sine",
    Equation_px=[0.5407254696, 0.3679539859],
    Equation_py=[0.6839491129, 0.5268839002])
number_slider_4 = Slider(3, range=0..10)
Z = UnitZ(Factor=number_slider_3)
Z_2 = UnitZ(Factor=1)
multiplication = Multiplication(A=graph, B=Slider(73.9, range=0..100))
amp = Amplitude(Vector=Z_2, Amplitude=multiplication)
brep = Brep(<brep referenced from the Rhino model>)
move = Move(Geometry=sdivide.Points, Motion=amp)  # -> Geometry, Transform
addition = Addition(A=number_slider_2, B=Slider(1, range=0..1))
Z_3 = UnitZ(Factor=Slider(-42, range=-101..100))
srfgrid_2 = SurfaceFromPoints(Points=flatten(move.Geometry), UCount=addition, Interpolate=False)
move_2 = Move(Geometry=srfgrid_2, Motion=Z_3)  # -> Geometry, Transform
sdivide_2 = DivideSurface(Surface=move_2.Geometry, UCount=Slider(100, range=0..100), VCount=Slider(100, range=0..100))  # -> Points, Normals, Parameters
pln = Plane(sdivide_2.Points)
item = ListItem(List=pln, Index=python.a, Wrap=True)
item_2 = ListItem(List=flatten(item), Index=python.b, Wrap=True)
cyl = Cylinder(Base=item_2, Radius=Slider(25, range=0..50), Length=Slider(40, range=0..50))
cyl_2 = Cylinder(Base=item_2, Radius=Slider(2, range=0..10), Length=number_slider_3)
cap = CapHoles(Brep=cyl_2)
move_3 = Move(Geometry=cyl, Motion=Z)  # -> Geometry, Transform
cap_2 = CapHoles(Brep=move_3.Geometry)
bbx = BrepBrep(BrepA=cap_2, BrepB=brep)  # -> Curves, Points
preview = CustomPreview(Geometry=cap_2, Material=ColourSwatch(SwatchColor=RGB(156, 165, 255)))
number_slider_5 = Slider(30, range=0..100)
join = BrepJoin(Breps=[srfgrid_2, srfgrid])  # -> Breps, Closed
loft = Loft(Curves=join.Breps, Options={Adjust=False, Closed=False, LoftEnds=0, LoftSimp=0, LoftType=0, Rebuild=10, Refit=0.01})
sdivide_3 = DivideSurface(Surface=move_2.Geometry, UCount=number_slider_5, VCount=number_slider_5)  # -> Points, Normals, Parameters
join_2 = BrepJoin(Breps=[loft, join.Breps])  # -> Breps, Closed
python_3 = GhPythonScript(x=sdivide_3.Points)  # -> out, a; inputs x: tree of Point3d
# ---------- python_3: Python ----------
import ghpythonlib.treehelpers as th
 
x = th.tree_to_list(x)
a = []
 
i = 0
for col in x:
    for row in col:
        if i % 2 == 0:
            row.reverse()
        i+=1
        for item in row:
            a.append(item)
# ---------- end python_3 ----------
intcrv = Interpolate(Vertices=python_3.a, Degree=3, Periodic=False, KnotStyle=1)  # -> Curve, Length, Domain
divide = DivideCurve(Curve=intcrv.Curve, Count=Slider(1100, range=0..1100), Kinks=False)  # -> Points, Tangents, Parameters
item_3 = ListItem(List=divide.Points, Index=python_2.a, Wrap=True)
move2pt = MoveToPoint(Geometry=cap, PointA=pt, PointB=item_3)  # -> Moved, Vector, Transform
pdecon = Deconstruct(Point=divide.Tangents)  # -> XComponent, YComponent, ZComponent
roundd = RoundToDecimalPlace(NumberX=pdecon.XComponent, DecimalPlace=number_slider_4, RoundType=0)  # -> Rounded, Difference
roundd_2 = RoundToDecimalPlace(NumberX=pdecon.ZComponent, DecimalPlace=number_slider_4, RoundType=0)  # -> Rounded, Difference
roundd_3 = RoundToDecimalPlace(NumberX=pdecon.YComponent, DecimalPlace=number_slider_4, RoundType=0)  # -> Rounded, Difference
concat = Concatenate(
    FragmentA="G1 F1200 X",
    FragmentB=roundd.Rounded,
    FragmentC=" Y",
    FragmentD=roundd_3.Rounded,
    FragmentE=" Z",
    FragmentF=roundd_2.Rounded)
panel = Panel(concat)
panel_2 = Panel(python_3.a)
rotate = Rotate(Geometry=intcrv.Curve, Angle=1.570796327, Plane=PlaneXY(0, 0, 0))  # -> Geometry, Transform
X = UnitX(Factor=Slider(100, range=0..100))
trigger_3 = Trigger(Interval=10, TimerInterval=10, Target=python_4)  # disabled
move_4 = Move(Geometry=rotate.Geometry, Motion=X)  # -> Geometry, Transform
Z_4 = UnitZ(Factor=Slider(1.5, range=0..10))
python_4 = GhPythonScript(state=Toggle(False))  # -> out, a; inputs state: Boolean; same code as python_2
move_5 = Move(Geometry=move_4.Geometry, Motion=Z_4)  # -> Geometry, Transform
divide_2 = DivideCurve(Curve=move_5.Geometry, Count=Slider(1100, range=0..1100), Kinks=False)  # -> Points, Tangents, Parameters
number_slider_6 = Slider(3, range=0..10)
rotate_2 = Rotate(Geometry=move_5.Geometry, Angle=1.570796327, Plane=PlaneXY(0, 0, 0))  # -> Geometry, Transform
pt_2 = Point(<point referenced from the Rhino model>)
item_4 = ListItem(List=divide_2.Points, Index=python_4.a, Wrap=True)
X_2 = UnitX(Factor=Slider(100, range=0..100))
move2pt_2 = MoveToPoint(Geometry=cap, PointA=pt_2, PointB=item_4)  # -> Moved, Vector, Transform
pdecon_2 = Deconstruct(Point=divide_2.Tangents)  # -> XComponent, YComponent, ZComponent
move_6 = Move(Geometry=rotate_2.Geometry, Motion=X_2)  # -> Geometry, Transform
Z_5 = UnitZ(Factor=Slider(1.5, range=0..10))
roundd_4 = RoundToDecimalPlace(NumberX=pdecon_2.XComponent, DecimalPlace=number_slider_6, RoundType=0)  # -> Rounded, Difference
roundd_5 = RoundToDecimalPlace(NumberX=pdecon_2.ZComponent, DecimalPlace=number_slider_6, RoundType=0)  # -> Rounded, Difference
roundd_6 = RoundToDecimalPlace(NumberX=pdecon_2.YComponent, DecimalPlace=number_slider_6, RoundType=0)  # -> Rounded, Difference
move_7 = Move(Geometry=move_6.Geometry, Motion=Z_5)  # -> Geometry, Transform
concat_2 = Concatenate(
    FragmentA="G1 F1200 X",
    FragmentB=roundd_4.Rounded,
    FragmentC=" Y",
    FragmentD=roundd_6.Rounded,
    FragmentE=" Z",
    FragmentF=roundd_5.Rounded)
panel_3 = Panel(concat_2)
trigger_4 = Trigger(Interval=10, TimerInterval=10, Target=python_5)  # disabled
divide_3 = DivideCurve(Curve=move_7.Geometry, Count=Slider(1100, range=0..1100), Kinks=False)  # -> Points, Tangents, Parameters
python_5 = GhPythonScript(state=Toggle(False))  # -> out, a; inputs state: Boolean; same code as python_2
number_slider_7 = Slider(3, range=0..10)
pt_3 = Point(<point referenced from the Rhino model>)
item_5 = ListItem(List=divide_3.Points, Index=python_5.a, Wrap=True)
move2pt_3 = MoveToPoint(Geometry=cap, PointA=pt_3, PointB=item_5)  # -> Moved, Vector, Transform
pdecon_3 = Deconstruct(Point=divide_3.Tangents)  # -> XComponent, YComponent, ZComponent
roundd_7 = RoundToDecimalPlace(NumberX=pdecon_3.XComponent, DecimalPlace=number_slider_7, RoundType=0)  # -> Rounded, Difference
roundd_8 = RoundToDecimalPlace(NumberX=pdecon_3.YComponent, DecimalPlace=number_slider_7, RoundType=0)  # -> Rounded, Difference
roundd_9 = RoundToDecimalPlace(NumberX=pdecon_3.ZComponent, DecimalPlace=number_slider_7, RoundType=0)  # -> Rounded, Difference
concat_3 = Concatenate(
    FragmentA="G1 F1200 X",
    FragmentB=roundd_7.Rounded,
    FragmentC=" Y",
    FragmentD=roundd_8.Rounded,
    FragmentE=" Z",
    FragmentF=roundd_9.Rounded)
panel_4 = Panel(concat_3)
panel_5 = Panel([panel, panel_3, panel_4])
